# Grasshopper definition Divide_Curve_Uneqully.gh (Grasshopper 1.0.7)
# plug-ins: ArchiCoder

pt = Point([Point(-24.44078869, -11.64859234, 0), Point(8.337938297, -9.943658549, 0), Point(6.468010919, 6.603967721, 0), Point(-4.091578983, 5.620736983, 0), Point(-22.7358549, 12.23100833, 0), Point(-23.325219, 26.03000509, 0), Point(-5.026542672, 24.17035047, 0), Point(7.952953249, 23.88002785, 0)])
intcrv = Interpolate(Vertices=reverse(pt), Degree=3, Periodic=False, KnotStyle=1)  # -> Curve, Length, Domain
toggle = BooleanToggle(True)
curve = Curve(intcrv.Curve)
series = Series(Start=Slider(0, range=0..1), Step=Slider(1, range=1..5), Count=Slider(15, range=1..50))

# ---- group: New division component
divide_unequally = DivideUnequally(Curve=curve, Distances=series, ExcludeLast=True)  # -> Points, Parameters, Succesfull

# ----
panel = Panel(divide_unequally.Succesfull)

pline = PolyLine(Vertices=divide_unequally.Points, Closed=False)
explode = Explode(Curve=pline, Recursive=True)  # -> Segments, Vertices
preview = CustomPreview(Geometry=divide_unequally.Points, Material=ColourSwatch(SwatchColor=RGB(255, 208, 0)))
swatch = ColourSwatch(SwatchColor=RGB(255, 255, 255))
curvepoint = PointOnCurve(explode.Segments, parameter=0.5)
len = Length(Curve=explode.Segments)
preview_2 = CustomPreview(Geometry=explode.Segments, Material=swatch)
tag = TextTag3D(Location=curvepoint, Text=len, Size=Slider(0.4, range=0..1), Colour=swatch, Justification=7)
